vi "valid_selector_types.gviweb"   [LabVIEW NXG 2.1.0]
panel controls:
  "Text Ring": i32
  "List Box": i32 = -1
  "stop": bool
panel indicators:
  "error out": error
  "error out_2": error
uses:
  webvipolyfill_propertynode_items::Items Property Set [webvipolyfill].gviweb
diagram:
  sequence {
    frame 0 {
      call "Items Property Set [webvipolyfill].gviweb"(css selector in="ni-ring-selector[ni-control-id='18']", Items=["hello"]) -> (error out=w1)
      $"error out" <- w1
    }
    frame 1 {
      while {
        stop if $stop
      }
    }
  }
  disable {
    frame Enabled { }
    frame Disabled {
      call "Items Property Set [webvipolyfill].gviweb"(css selector in="jqx-list-box[ni-control-id='23']", Items=["world"]) -> (error out=w2)
      $"error out_2" <- w2
    }
  }
