vi "all_log_types.gviweb"   [LabVIEW NXG 2.1.0]
panel indicators:
  "error out": error
uses:
  webvipolyfill_writetosystemlog::Write to System Log [webvipolyfill].gviweb
diagram:
  call "Write to System Log [webvipolyfill].gviweb"(message="Easy Error", severity="Error"(0)) -> (error out=w1)
  call "Write to System Log [webvipolyfill].gviweb"(message="Worrisome Warning", severity="Warning"(1), error in=w1) -> (error out=w2)
  call "Write to System Log [webvipolyfill].gviweb"(message="Indescribable Informational ", severity="Informational"(2), error in=w2) -> (error out=w3)
  $"error out" <- w3
