vi "webvihack_version_error.gviweb"   [LabVIEW NXG 2.1.0]
outputs:
  "webvihack_version_error_message": string
  "webvihack_version_error_code": i32
uses:
  webvihack::webvihack_version.gviweb
diagram:
  w1 = "The webvihack.js, webvihack_functions.js, and / or block diagram version do not match. Make sure to use webvihack scripts and components from the same package version. The gvi expects version ("
  call "webvihack_version.gviweb"() -> (webvihack_version=w2)
  Format Into String(w2) -> w3
  Concatenate Strings(w1, w3, ").") -> w4
  $webvihack_version_error_message <- w4
  w5 = 10001  # webvihack_version_error_code
  $webvihack_version_error_code <- w5
