vi "Items Property Set [webvihack].gviweb"   [LabVIEW NXG 2.1.0]
inputs:
  "css selector in": string  # The CSS Selector from the right rail for the control that will be updated
  "error in": error
  "Items": string[]  # Array of items from which you can select in the control.
outputs:
  "error out": error
  "css selector out": string  # The CSS Selector from the right rail for the control that will be updated
types:
  T1 = cluster{"webvihack_version": i32, "css selector in": string, "Items": string[]}
uses:
  webvihack::webvihack_version.gviweb
  webvihack::webvihack.gviweb
  webvihack::webvihack_version_error_merge.gviweb
diagram:
  call "webvihack_version.gviweb"() -> (webvihack_version=w1)
  Property Node(instance in=T1 {all zero or empty}, "webvihack_version"=w1, "css selector in"=$"css selector in", "Items"=$Items) -> (instance out=w2)
  Flatten To JSON(anything=w2, enable LabVIEW extensions=TRUE, error in (no error)=$"error in") -> (JSON string=w3, error out=w4)
  call "webvihack.gviweb"(action="webvihack_propertynode_items", input=w3, error in=w4) -> (output=w5, error out=w6)
  Decimal String To Number(default (0 I32)=0, offset=0, string=w5) -> (number=w7)
  call "webvihack_version_error_merge.gviweb"(error in=w6, error code in=w7) -> (error out=w8)
  $"error out" <- w8
  $"css selector out" <- $"css selector in"
