vi "Write to System Log [webvihack].gviweb"   [LabVIEW NXG 2.1.0]
# Writes a message to the output pane accessible from Tool Launcher > All > Output in LabVIEW NXG or the browser development tools console usually accessible with F12 in the browser.
inputs:
  "message": string, required  # message is the text to write to the system log.
  "severity": i32 = "Error"(0)
  "error in": error
outputs:
  "error out": error
types:
  T1 = cluster{"webvihack_version": i32, "severity": i32, "message": string}
uses:
  webvihack::webvihack_version.gviweb
  webvihack::webvihack.gviweb
  webvihack::webvihack_version_error_merge.gviweb
diagram:
  call "webvihack_version.gviweb"() -> (webvihack_version=w1)
  Property Node(instance in=T1 {all zero or empty}, "webvihack_version"=w1, "severity"=$severity, "message"=$message) -> (instance out=w2)
  Flatten To JSON(anything=w2, enable LabVIEW extensions=TRUE, error in (no error)=$"error in") -> (JSON string=w3, error out=w4)
  call "webvihack.gviweb"(action="webvihack_writetosystemlog", input=w3, error in=w4) -> (output=w5, error out=w6)
  Decimal String To Number(default (0 I32)=0, offset=0, string=w5) -> (number=w7)
  call "webvihack_version_error_merge.gviweb"(error in=w6, error code in=w7) -> (error out=w8)
  $"error out" <- w8
