vi "webvipolyfill.gviweb"   [LabVIEW NXG 2.0.0]
inputs:
  "action": string, required
  "input": string
  "error in": error
outputs:
  "output": string
  "error out": error
uses:
  NI::HTTP::POST Buffer.gvi
diagram:
  Concatenate Strings("webvipolyfill:", $action) -> w1
  call "POST Buffer.gvi"(timeout=-1, url=w1, buffer=$input, error in=$"error in") -> (body=w2, error out=w3)
  $output <- w2
  $"error out" <- w3
