vi "webvipolyfill.gviweb"   [LabVIEW NXG 2.1.0]
inputs:
  "action": string, required
  "input": string
  "error in": error
outputs:
  "output": string
  "error out": error
uses:
  NI::HTTP::POST Buffer.gvi
  NI::G Core::Error::Is Error.gvi
  NI::G Core::Error::Build Error Cluster.gvi
diagram:
  case ($"error in") {
    frame Error, Default {
      w1 = $"error in"
    }
    frame No Error {
      Concatenate Strings("webvipolyfill:", $action) -> w2
      call "POST Buffer.gvi"(timeout=-1, client handle=0, url=w2, buffer=$input, error in=$"error in", output file=path constant) -> (status code=w3, body=w4, error out=w5)
      $output <- w4
      case (w3) {
        frame Default {
          w8 = 0  # no error
          w6 = w8
          w7 = ""
        }
        frame 44300 {
          Concatenate Strings("An exception occurred invoking JavaScript function (", $action, ") with the following input (", $input, ").") -> w7
          w6 = w3
        }
        frame 44302 {
          Concatenate Strings("The JavaScript function (", $action, ") could not be found") -> w7
          w6 = w3
        }
        frame 44304 {
          Concatenate Strings("Invalid return type from JavaScript function (", $action, ") invoked with input (", $input, "). Must return a JavaScript string.") -> w7
          w6 = w3
        }
      }
      w9 = "Error attempting to invoke the webvipolyfill library. Make sure webvipolyfill.js and webvipolyfill_functions.js are added to your Web Application component and that they are added as script tags in the HTML of your Top-Level gviweb."
      w10 = 10000  # error
      w11 = 0  # no error
      call "Is Error.gvi"(error in=w5) -> (error?=w12)
      Select(s=w12, t=w10, f=w11) -> w13
      call "Build Error Cluster.gvi"(error in=no error, code=w13, description=w9, include call chain=TRUE, make warning=FALSE) -> (error out=w14)
      To Long Integer(number=w6) -> w15
      call "Build Error Cluster.gvi"(error in=w14, code=w15, description=w7, include call chain=TRUE, make warning=FALSE) -> (error out=w1)
    }
  }
  $"error out" <- w1
