vi "webvipolyfill_version_error.gviweb"   [LabVIEW NXG 2.1.0]
outputs:
  "webvipolyfill_version_error_message": string
  "webvipolyfill_version_error_code": i32
uses:
  webvipolyfill::webvipolyfill_version.gviweb
diagram:
  w1 = "The webvipolyfill.js, webvipolyfill_functions.js, and / or block diagram version do not match. Make sure to use webvipolyfill scripts and components from the same package version. The gvi expects version ("
  call "webvipolyfill_version.gviweb"() -> (webvipolyfill_version=w2)
  Format Into String(w2) -> w3
  Concatenate Strings(w1, w3, ").") -> w4
  $webvipolyfill_version_error_message <- w4
  $webvipolyfill_version_error_code <- 10001
