vi "webvipolyfill_version_error_merge.gviweb"   [LabVIEW NXG 2.1.0]
inputs:
  "error in": error
  "error code in": i32
outputs:
  "error out": error
uses:
  webvipolyfill::webvipolyfill_version_error.gviweb
  NI::G Core::Error::Build Error Cluster.gvi
diagram:
  call "webvipolyfill_version_error.gviweb"() -> (webvipolyfill_version_error_message=w1, webvipolyfill_version_error_code=w2)
  Is Equal(x=w2, y=$"error code in") -> w3
  w4 = 0  # no error
  Select(s=w3, t=w2, f=w4) -> w5
  call "Build Error Cluster.gvi"(error in=$"error in", code=w5, description=w1, include call chain=TRUE, make warning=FALSE) -> (error out=w6)
  $"error out" <- w6
